# Grasshopper definition Campus Planning - Shape in a Parcel V3.gh (Grasshopper 0.9.76)

# ----
# PARCEL OUTLINE
# (flip inward if neccesary)
panel = Panel("450")
flip = BooleanToggle(False)
# STILL NOT MITERING AT STUBBY ENDS
# CORRECT BY OFFSETTING ENTIRE PARCEL BOUNDARY, THEN EXPLODING AND THEN CHOOSING SEGMENTS FOR LOFT.
# Author : Robert Narracci, PCPA
# SET UNITS TO FEET
# (at the moment, this is designed only to process quadrilateral parcels
# and I'm not sure what one does with inherited parcel lines that are
# triangual, pentagonal, etc....maybe find a rectangle within?)
rectangle = Rectangle(Plane=PlaneXY(0, 0, 0), XSize=panel, YSize="300", Radius=0)  # -> Rectangle, Length

crv = Curve(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)

# ----
# CONTROLS
# BASIC
property_line_setback = Slider(20, range=0..50)
number_of_floors = Slider(8, range=0..50)
typical_floor_height = Slider(14, range=0..50)
ground_floor_height = Slider(20, range=0..50)
building_wing_width = Slider(80, range=0..100)
# POSSIBLE SHAPES HERE :
# BAR
# L-SHAPE
# U-SHAPE
list = ValueList({"Single Bar 0": 0, "Single Bar 1": 1, "Single Bar 2": 2, "Single Bar 3": 3, "L-Shape 0 1": "0,1", "L-Shape 1 2": "1,2", "L-Shape 2 3": "2,3", "L-Shape 3 0": "3,0", "U-Shape 0 1 2": "0,1,2", "U-Shape 1 2 3": "1,2,3", "U-Shape 2 3 0": "2,3,0", "U-Shape 3 0 1": "3,0,1"}, selected="U-Shape 0 1 2")

# ----
# FEED ME THE
# OUTLINE OF A PARCEL
# SETBACK LINE
crv_2 = Curve(crv)
flip_2 = FlipCurve(Curve=crv_2)  # -> Curve, Flag
gate = StreamGate(Stream=crv_2, Gate=flip)  # -> Target0, Target1
gate_2 = StreamGate(Stream=flip_2.Curve, Gate=flip)  # -> Target0, Target1
offset = Offset(Curve=[gate.Target0, gate_2.Target1], Distance=property_line_setback, Plane=PlaneXY(0, 0, 0), Corners=1)

# ----
# EXTRUSION HT AND CONTOUR SPACING
panel_2 = Panel("2")
subtraction = Subtraction(A=number_of_floors, B=panel_2)
series = Series(Start=typical_floor_height, Step=0, Count=subtraction)
eval = Evaluate(F="z+y*(x-1)", x=number_of_floors, y=typical_floor_height, z=ground_floor_height)
merge = Merge(Data1="0", Data2=ground_floor_height, Data3=series)  # -> flatten(Result)
panel_3 = Panel(eval)

# ----
# SHAPE CREATION
# (U-Shapes display weird but bake OK)
split = TextSplit(Text=list, Separators=",")
brep = Brep(offset)
building_wing = BuildingWing(building_wing_width=building_wing_width, setback_line=brep, building_edge=split, building_height=panel_3)

# ----
# FLOORS AND
# AREA CALCS
contour = ContourEx(Shape=building_wing, Plane=PlaneXY(0, 0, 0), Distances=merge)
area = Area(Geometry=contour)  # -> Area, Centroid
int = Integer(area.Area)
ma = MassAddition(Input=flatten(int))  # -> Result, PartialResults
panel_4 = Panel(ma.Result)
panel_5 = Panel(int)

# ----
# OTHER SHAPES
# TO CONSIDER IN
# OTHER CODE:
# H-SHAPE
# T-SHAPE
# TRIANGLE
flr_area_total = Panel(panel_4)
flr_areas = Panel(panel_5)

# ==== cluster BuildingWing
building_height = ClusterInput()  # Building Height
building_edge = ClusterInput()  # Building Edge
setback_line = ClusterInput()  # Setback Line
building_wing_width = ClusterInput()  # Building Wing Width
area = Area(Geometry=setback_line)  # -> Area, Centroid
debrep = DeconstructBrep(Brep=setback_line)  # -> Faces, Edges, Vertices
item = ListItem(List=debrep.Edges, Index=building_edge, Wrap=True)
curvepoint = PointOnCurve(item, parameter=0.5)
join = JoinCurves(Curves=item, Preserve=False)
vec2pt = Vector2Pt(PointA=curvepoint, PointB=area.Centroid, Unitize=False)  # -> Vector, Length
offset = Offset(Curve=join, Distance=building_wing_width, Plane=vec2pt.Vector, Corners=1)
curvepoint_2 = PointOnCurve(offset, parameter=0)
end = EndPoints(Curve=join)  # -> Start, End
ln = Line(StartPoint=end.Start, EndPoint=curvepoint_2)
swp2 = Sweep2(Rail1=join, Rail2=offset, Sections=ln, SameHeight=False)
item_2 = ListItem(List=swp2, Index=Slider(0, range=0..10), Wrap=True)
Z = UnitZ(Factor=building_height)
extr = Extrude(Base=swp2, Direction=Z)
cap = CapHoles(Brep=extr)
B = ClusterOutput(cap)
